# Grasshopper definition setConstructionSet.gh (Grasshopper 0.9.76)
# plug-ins: Python Interpreter, ItemSelector

wall_surface_with_opening = Brep(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)

# ---- group: floor
floor = Brep(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)

# ----
ledge = Brep(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)

# ---- group: ceiling
ceiling = Brep([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])

# ----
walls = Brep([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])
geo = Geometry(<brep referenced from the Rhino model>)
ladybug = Ladybug_Ladybug()  # -> Vviiiiiiiiiizzz; plug-in component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
honeybee = Honeybee_Honeybee()  # -> Vviiiiiiiiiizzz; plug-in component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
glazingcreator = Honeybee_GlazingBasedOnRatio(glzRatio=0.4, runIt=Toggle(True))  # -> readMe, HBObjWGLZ; plug-in component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
createhbsrfs = Honeybee_createHBSrfs(geometry=[floor, ledge], srfType="3")  # -> readMe, simplify(HBSurface); plug-in component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
createhbsrfs_2 = Honeybee_createHBSrfs(geometry=wall_surface_with_opening, srfType="0")  # -> readMe, simplify(HBSurface); plug-in component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
createhbsrfs_3 = Honeybee_createHBSrfs(geometry=ceiling, srfType="3")  # -> readMe, simplify(HBSurface); plug-in component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
# Honeybee default materials will be assigned
# based on surface type
createhbsrfs_4 = Honeybee_createHBSrfs(geometry=ceiling, srfType="0")  # -> readMe, simplify(HBSurface); plug-in component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
createhbsrfs_5 = Honeybee_createHBSrfs(geometry=walls, srfType="0")  # -> readMe, simplify(HBSurface); plug-in component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
bldgprograms = Honeybee_bldgPrograms({"Office": 0, "Retail": 1, "MidriseApartment": 2, "PrimarySchool": 3, "SecondarySchool": 4, "SmallHotel": 5, "LargeHotel": 6, "Hospital": 7, "Outpatient": 8, "Warehouse": 9, "SuperMarket": 10, "FullServiceRestaurant": 11, "QuickServiceRestaurant": 12}, selected="SecondarySchool")
decomposebytype = Honeybee_DecomposeBasedOnType(HBZone=glazingcreator.HBObjWGLZ)  # -> walls, interiorWalls, airWalls, windows, interiorWindows, skylights, roofs, ceilings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; plug-in component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
listzoneprograms = Honeybee_ListZonePrograms(bldgProgram=bldgprograms)  # -> SecondarySchoolZonePrograms; plug-in component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
glass = Brep(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)
addhbglz = Honeybee_addHBGlz(HBObj=createhbsrfs_2.HBSurface, childSurfaces=flatten(glass))  # -> HBObjWGLZ; plug-in component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

# ---- group: collect all honeybee surfaces
brep = Brep(flatten([createhbsrfs_5.HBSurface, createhbsrfs_4.HBSurface, createhbsrfs_3.HBSurface, createhbsrfs.HBSurface, addhbglz]))

# ----
list = Honeybee_ItemSelector(
    listzoneprograms,
    {"SecondarySchool::Mechanical", "SecondarySchool::Library", "SecondarySchool::Auditorium", "SecondarySchool::Cafeteria", "SecondarySchool::Gym", "SecondarySchool::Restroom", "SecondarySchool::Office", "SecondarySchool::Classroom", "SecondarySchool::Kitchen", "SecondarySchool::Corridor", "SecondarySchool::Lobby"}, selected="SecondarySchool::Mechanical")
panel = Panel("Rough")
climate_zones = Honeybee_bldgPrograms({"ClimateZone 1": 0, "ClimateZone 2": 1, "ClimateZone 3": 2, "ClimateZone 4": 3, "ClimateZone 5": 4, "ClimateZone 6": 5, "ClimateZone 7": 6, "ClimateZone 8": 7, "Climatezone 1-2": 8, "Climatezone 1-3": 9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}, selected="ClimateZone 8")
panel_3 = Panel(climate_zones)
standards = Honeybee_bldgPrograms({"189.1-2009": 0, "90.1-2007": 1, "90.1-2010": 2, "DOE Ref 1980-2004": 3, "DOE Ref 2004": 4, "DOE Ref Pre-1980": 5}, selected="90.1-2007")
python = PythonScript(zonePrograms=list, standard=standards, climateZone=climate_zones)  # -> readMe, a; inputs standard: Int32, climateZone: Int32
# ---------- python: Python ----------
import rhinoscriptsyntax as rs
import Rhino as rc
import scriptcontext as sc
import os
import sys
import System
import Grasshopper.Kernel as gh
import uuid
import re

hb_EPMaterialAUX = sc.sticky["honeybee_EPMaterialAUX"]()
hb_EPObjectsAux = sc.sticky["honeybee_EPObjectsAUX"]()
openStudioStandardLib = sc.sticky ["honeybee_OpenStudioStandardsFile"]

#print openStudioStandardLib["construction_sets"]["189.1-2009"]["ClimateZone 1"].keys()

def convertStandardIntToString(standard):
        
        if standard == 0:
            
            return '189.1-2009'
            
        if standard == 1:
            
            return '90.1-2007'
           
        if standard == 2:
            
            return '90.1-2010'
            
        if standard == 3:
            
            return 'DOE Ref 1980-2004'
            
        if standard == 4:
            
            return 'DOE Ref 2004'
            
        if standard == 5:
            
            return 'DOE Ref Pre-1980'
            
def convertClimateTypetoString(climateZone):
    
    if climateZone == 0:
        
        return 'ClimateZone 1'
        
    if climateZone == 1:
        
        return 'ClimateZone 2'
        
    if climateZone == 2:
        
        return 'ClimateZone 3'
        
    if climateZone == 3:
        
        return 'ClimateZone 4'
        
    if climateZone == 4:
        
        return 'ClimateZone 5'
        
   if climateZone == 5:
        
        return 'ClimateZone 6'
        
   if climateZone == 6:
        
        return 'ClimateZone 7'
        
   if climateZone == 7:
        
        return 'ClimateZone 8'
        
   if climateZone == 8:
        
        return 'Climatezone 1-2'
        
   if climateZone == 9:
        
        return 'Climatezone 1-3'
        
   if climateZone == 10:
        
        return 'Climatezone 1-5'
        
   if climateZone == 11:
        
        return 'Climatezone 1-8'
        
   if climateZone == 12:
        
        return 'Climatezone 2-7'
        
   if climateZone == 13:
        
        return 'ClimateZone 4-5'
        
   if climateZone == 14:
        
        return 'ClimateZone 5-6'
        
   if climateZone == 15:
        
        return 'ClimateZone 6-8'
        
   if climateZone == 16:
        
        return 'ClimateZone 7-8'
        
   if climateZone == 17:
        
        return 'ClimateZone 1-8'
        
   if climateZone == 18:
        
        return 'ClimateZone 2a'
        
   if climateZone == 19:
        
        return 'ClimateZone 2b'
        
   if climateZone == 20:
        
        return 'ClimateZone 3a'
        
   if climateZone == 21:
        
        return 'ClimateZone 4a'
        
   if climateZone == 22:
        
        return 'ClimateZone 5a'
        
   if climateZone == 23:
        
        return 'ClimateZone 3c'
        
   if climateZone == 24:
        
        return 'ClimateZone 4c'
        
   if climateZone == 25:
        
        return 'ClimateZone 3a-3b'
        
   if climateZone == 26:
        
        return 'ClimateZone 3b'
        
   if climateZone == 27:
        
        return 'ClimateZone 4b'
        
   if climateZone == 28:
        
        return 'ClimateZone 5b'
        
   if climateZone == 29:
        
        return 'ClimateZone 6b'
        
   if climateZone == 30:
        
        return 'ClimateZone 1-3b'
        
def atoi(text):
    return int(text) if text.isdigit() else text

def natural_keys(text):
    """
    alist.sort(key=natural_keys) sorts in human order
    http://nedbatchelder.com/blog/200712/human_sorting.html
    (See Toothy's implementation in the comments)
    """
    return [ atoi(c) for c in re.split('(\d+)', text) ]

def sortClimateZones(climateZones):
    """
    # Code for sorting taken from http://stackoverflow.com/questions/5967500/how-to-correctly-sort-a-string-with-a-number-inside
    # Producing human sorting or natural sorting"""

    climateZones.sort(key=natural_keys)
    
    return climateZones


buildingProgram = zonePrograms_.split("::")[0]

climateZone = convertClimateTypetoString(climateZone_)

standard = convertStandardIntToString(standard_)

def checkInputs(standard,climateZone):
    
    climateZone = convertClimateTypetoString(climateZone_)

    standard = convertStandardIntToString(standard_)
    
    try:
        
        openStudioStandardLib["construction_sets"][standard][climateZone]
        
    except:

        if climateZone not in openStudioStandardLib["construction_sets"][standard].keys():
            
            availableClimateZones = []
            
            climateZones = openStudioStandardLib["construction_sets"][standard].keys()
            
            availableClimateZones = sortClimateZones(climateZones)
                
            warning = "\n" + \
            "The climate zone "+str(climateZone)+ " that you picked is not listed under standard "+str(standard)+" \n" + \
            "The following climate zones are listed under " + (standard) + " \n" + \
            " \n ".join(availableClimateZones) +" \n" + \
            " pick one of these"
            w = gh.GH_RuntimeMessageLevel.Warning
            ghenv.Component.AddRuntimeMessage(w, warning)
            
            print warning
            
            return 

    try:
        
        openStudioStandardLib["construction_sets"][standard][climateZone][buildingProgram]
        
    except:
        
        if buildingProgram not in openStudioStandardLib["construction_sets"][standard][climateZone].keys():
            
            availableBuildingPrograms = []
            
            for climate in openStudioStandardLib["construction_sets"][standard].keys():
                
                if buildingProgram in openStudioStandardLib["construction_sets"][standard][climate].keys():
                    
                    availableBuildingPrograms.append(climate)
                    
            warning = "\n" + \
            "The "+str(buildingProgram)+ " building program that you picked is not listed under the "+ str(climateZone)+" \n" + \
            "For this standard "+ str(buildingProgram)+ " is listed under the following climate zones: \n" + \
            " \n ".join(availableBuildingPrograms) +" \n" + \
            " pick one of these"
            w = gh.GH_RuntimeMessageLevel.Warning
            ghenv.Component.AddRuntimeMessage(w, warning)
            
            print warning
            
            return


checkInputs(standard_,climateZone_)

#ghenv.Component.AddRuntimeMessage(w, warning)
# ---------- end python ----------
epopaquemat = Honeybee_EnergyPlusOpaqueMaterial(
    name="testlayer1",
    thickness="0.4",
    conductivity="0.4",
    density="0.4",
    specificHeat="0.4",
    thermAbsp="0.4",
    solAbsp="0.4",
    visAbsp="0.4")  # -> EPMaterial; plug-in component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
epopaquemat_2 = Honeybee_EnergyPlusOpaqueMaterial(
    name="testlayer2",
    thickness="0.4",
    conductivity="0.4",
    density="0.4",
    specificHeat="0.4",
    thermAbsp="0.4",
    solAbsp="0.4",
    visAbsp="0.4")  # -> EPMaterial; plug-in component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
preview = CustomPreview(Geometry=glass, Shader=ColourSwatch(SwatchColor=RGBA(80, 222, 255, 160)))
askme = Honeybee_AskMe(HBObjects=brep)  # -> readMe; plug-in component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
python_2 = PythonScript()  # -> out, a
# ---------- python_2: Python ----------
import rhinoscriptsyntax as rs
import Rhino as rc
import scriptcontext as sc
import os
import sys
import System
import Grasshopper.Kernel as gh
import uuid
import re

import re

def atoi(text):
    return int(text) if text.isdigit() else text

def natural_keys(text):
    """
    alist.sort(key=natural_keys) sorts in human order
    http://nedbatchelder.com/blog/200712/human_sorting.html
    (See Toothy's implementation in the comments)
    """
    return [ atoi(c) for c in re.split('(\d+)', text) ]


uniqueClimateZones = set()

openStudioStandardLib = sc.sticky ["honeybee_OpenStudioStandardsFile"]

for standard in openStudioStandardLib["construction_sets"].keys():
    
    for climateZone in openStudioStandardLib["construction_sets"][standard].keys():
        
        uniqueClimateZones.add(climateZone)
        
uniqueClimateZonesSorted = list(uniqueClimateZones)


uniqueClimateZonesSorted.sort(key=natural_keys)

print len(uniqueClimateZones)

for item in uniqueClimateZones:
    
    print item
# ---------- end python_2 ----------
python_3 = PythonScript()  # -> out, a
# ---------- python_3: Python ----------
import rhinoscriptsyntax as rs
import Rhino as rc
import scriptcontext as sc
import os
import sys
import System
import Grasshopper.Kernel as gh
import uuid
import re

import re

def atoi(text):
    return int(text) if text.isdigit() else text

def natural_keys(text):
    """
    alist.sort(key=natural_keys) sorts in human order
    http://nedbatchelder.com/blog/200712/human_sorting.html
    (See Toothy's implementation in the comments)
    """
    return [ atoi(c) for c in re.split('(\d+)', text) ]


uniqueClimateZones = set()

openStudioStandardLib = sc.sticky ["honeybee_OpenStudioStandardsFile"]

bldgProgram = 'SecondarySchool'

print availableBuildingPrograms
        
uniqueClimateZonesSorted = list(uniqueClimateZones)


uniqueClimateZonesSorted.sort(key=natural_keys)
# ---------- end python_3 ----------
panel_5 = Panel(epopaquemat_2)
panel_6 = Panel(askme)
createhbzones = Honeybee_createHBZones(
    name="Test",
    zoneProgram=list,
    standard=standards,
    climateZone=climate_zones,
    HBSurfaces=flatten(brep),
    isConditioned=True)  # -> readMe, HBZone; plug-in component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
mass2zone = Honeybee_Masses2Zones(
    zoneMasses=flatten(geo),
    zonePrograms=list,
    standard=standards,
    climateZone=climate_zones,
    isConditioned=True,
    maxRoofAngle=30,
    createHBZones=Toggle(True))  # -> readMe, HBZones; plug-in component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
epconstruction = Honeybee_EnergyPlusConstruction(name="testing", layer_1=epopaquemat, layer_2=epopaquemat_2)  # -> EPConstruction; plug-in component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
epconstruction_2 = Honeybee_EnergyPlusConstruction()  # -> EPConstruction; plug-in component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
decomposebytype_2 = Honeybee_DecomposeBasedOnType(HBZone=mass2zone.HBZones)  # -> flatten(walls), interiorWalls, airWalls, windows, interiorWindows, skylights, roofs, ceilings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; plug-in component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
toggle = BooleanToggle(True)
panel_7 = Panel(epconstruction)
setepzonecnstr = Honeybee_SetEPZoneConstruction(windowEPConstruction=epconstruction)  # -> simplify(modifiedHBZones); plug-in component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
addtoeplibrary = Honeybee_AddToEnergyPlusLibrary(EPObject=epconstruction, addToProjectLib=toggle, overwrite=toggle)  # -> readMe; plug-in component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
panel_8 = Panel(decomposebytype_2.walls)
panel_9 = Panel(decomposebytype_2.windows)
exportladybug = Ladybug_ExportLadybug(components=createhbzones.HBZone, targetFolder="C:\Users\szilasia\Documents\Honeybee", export=Toggle(True))  # -> readMe; plug-in component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
panel_10 = Panel(exportladybug)
